# Requirement set Requirements (R2024b)

## 1 [1] Detections

## 2 [2] Smoothness
The braking should be smooth to ensure passenger comfort while ensuring effectiveness in stopping the vehicle. That is to say that the peak jerk experienced by the RZR should be less than 6 m/s^2.

## 3 [3] Velocity
The control system must accurately track the prescribed velocity setpoint, with minimal deviation. That is to say that the average estimated velocity error must be within acceptible bounds of +/- 1 m/s.

## 4 [4] Collision
The system must prevent any collision under all valid scenarios within its operational limits. That is to say that the total number of collisions of the RZR should be 0.