test file "Tests"

suite "AEB"

  case "AEB" [baseline]
    model AutoDRIVE_RZR_AEB
    parameter set "Parameter Set 1": TimeOfDay = 560, WeatherID = 6  % model workspace
    parameter set "Parameter Set 2" (off): TimeOfDay = 0, WeatherID = 3  % model workspace
    cleanup callback:
      plot(squeeze(sltest_simout.get('logsout').get("X").Values.Data), ...
           squeeze(sltest_simout.get('logsout').get("Y").Values.Data));
      xlabel("X (m)");
      ylabel("Y (m)");
      axis equal;
    custom criteria (off):
      out = test.sltest_simout.logsout;
      plot(squeeze(out.get("X").Values.Data), squeeze(out.get("Y").Values.Data));
      xlabel("X (m)");
      ylabel("Y (m)");
      axis equal;
    assessment "Collision Check": At any point of time, collisionCount < uint16(1) must be true
      collisionCount: signal AutoDRIVE_RZR_AEB/Simulation|Simulation/AutoDRIVE RZR, port 2
    iterations:
      Iteration1: ParameterSet "Parameter Set 1", VariantConfiguration "YOLO_V2_TINY"
      Iteration2: ParameterSet "Parameter Set 2", VariantConfiguration "YOLO_V2_TINY"
      Iteration3: ParameterSet "Parameter Set 1", VariantConfiguration "YOLO_V4"
      Iteration4: ParameterSet "Parameter Set 2", VariantConfiguration "YOLO_V4"